# Grasshopper definition personable_robotics_osc.gh (Grasshopper 1.0.7)
# plug-ins: Firefly.X

# ---- group: IP Addr & Port
panel = Panel("127.0.0.1")
txt = Text("192.168.11.66")
int = Integer("55555")

# ---- group: tcp_target
# This example streams out a `tcp_target` and
# `tcp_look_at` point over OSC every time you
# move the points in the corresponding
# personable_robotics_osc.3dm file.
tcp_target = Point(<point referenced from the Rhino model>)
pdecon = Deconstruct(Point=tcp_target)  # -> XComponent, YComponent, ZComponent
panel_2 = Panel(pdecon.XComponent)
panel_3 = Panel(pdecon.ZComponent)
panel_4 = Panel(pdecon.YComponent)
osc_sender = OSCSender(Data=tcp_target, IPAddressOfUDPServer=txt, UDPPort=int)

# ---- group: look_at_target
look_at_target = Point(<point referenced from the Rhino model>)
pdecon_2 = Deconstruct(Point=look_at_target)  # -> XComponent, YComponent, ZComponent
panel_5 = Panel(pdecon_2.XComponent)
panel_6 = Panel(pdecon_2.ZComponent)
panel_7 = Panel(pdecon_2.YComponent)
osc_sender_2 = OSCSender(Data=look_at_target, IPAddressOfUDPServer=txt, UDPPort=int)

# ---- group: Test Receiving Locally
timer = Timer(TimerInterval=20, Target=osc_listener)
osc_listener = OSCListener(Port=int, Reset=Toggle(False))
panel_8 = Panel(osc_listener)
