# Grasshopper definition controller_template.gh (Grasshopper 1.0.8)
# plug-ins: RhinoCodePluginGH

# ----
# Network Settings
number_slider = Slider(55556, range=50000..59999)

# ----
# Controls
panel = Panel("/enable")
oscsender_py3 = Python3Script(host="192.168.1.138", port=number_slider, msg_addr=panel, data=Toggle(False))  # -> out, a; inputs host: String, port: Int32, msg_addr: String, data: list
# ---------- oscsender_py3: Python ----------
from pythonosc import udp_client

# set up the OSC Sender
client = udp_client.SimpleUDPClient(host, port) 
# send the message       
client.send_message(msg_addr, data)
# ---------- end oscsender_py3 ----------

z = Slider(0.343, range=0..1)

# ----
# Motion
x = Slider(0.33, range=0..1)
index = Slider(1, range=0..1)
y = Slider(0.726, range=0..1)
index_2 = Slider(0, range=0..1)
merge = Merge(Data1=index_2, Data2=Button())
merge_2 = Merge(Data1=index, Data2=x, Data3=y, Data4=z)
oscsender_py3_2 = Python3Script(host="192.168.1.138", port=number_slider, msg_addr="/motion/pos", data=merge_2)  # -> out, a; inputs host: String, port: Int32, msg_addr: String, data: list
# ---------- oscsender_py3_2: Python ----------
from pythonosc import udp_client

# set up the OSC Sender
client = udp_client.SimpleUDPClient(host, port)
# cast index from float to int
data[0] = int(data[0])   
# send the message       
client.send_message(msg_addr, data)
# ---------- end oscsender_py3_2 ----------
oscsender_py3_3 = Python3Script(host="192.168.1.138", port=number_slider, msg_addr="/motion/reset", data=merge)  # -> out, a; inputs host: String, port: Int32, msg_addr: String, data: list; same code as oscsender_py3
